# Grasshopper definition Examples.gh (Grasshopper 1.0.7)
# Copyright: Werner Sobek AG
# plug-ins: sof_gh_sofistik_rhino, SOFi_CDB_Access_3.0

io = IO(
    SofistikDocumentProperties_VersionMajor="2020",
    SofistikDocumentProperties_VersionMinor="8",
    SofistikDocumentProperties_VersionName="Rhino-Interface")

# ----
# Input
# Define the CDB_Path and
# switch toggle to true
toggle = BooleanToggle(False)
cdb_path = FilePath()
first_group = Panel("1")
last_group = Panel("10")
load_cases = Panel("""1
2""")

# ----
# Beams
groups = Panel("""1
2""")
pt = Point(<point referenced from the Rhino model>)
connectionforces = ConnectionForces(
    TrueFalse=toggle,
    CDBPath=cdb_path,
    SOFiSTiKGroups=groups,
    LoadCases=load_cases,
    PointAtTheNode=pt,
    DLLFolder="C:\Program Files\SOFiSTiK\2020\SOFiSTiK 2020\interfaces\64bit")  # -> BeamElement, YDirection, AdjacentPoint, BeamNumber, FAtNode_kN, MAtNode_kN, FAdjacentNode_kN, MAdjacentNode_kN, AddLoadF_kN, AddLoadM_kN
getbeamnodes = GetBeamNodes(
    TrueFalse=toggle,
    CDBPath=cdb_path,
    FirstSOFiSTiKGroups=first_group,
    LastSOFiSTiKGroups=last_group,
    DLLFolder="C:\Program Files\SOFiSTiK\2020\SOFiSTiK 2020\interfaces\64bit")  # -> BeamNumber, BeamNode1, BeamNode2, Node13DPoint, Node23DPoint, CrossSectionNode1, CrossSectionNode2, LocalCoordinates
getbeamforces = GetBeamForces(
    TrueFalse=toggle,
    CDBPath=cdb_path,
    FirstSOFiSTiKGroups=first_group,
    LastSOFiSTiKGroups=last_group,
    LoadCases=load_cases,
    DLLFolder="C:\Program Files\SOFiSTiK\2020\SOFiSTiK 2020\interfaces\64bit")  # -> BeamNumber, LengthOfTheBeam, NormalForcesNode1_kN, ShearForcesVyNode1_kN, ShearForcesVzNode1_kN, TorsionalMomentMtNode1_kNm, BendingMomentMyNode1_kNm, BendingMomentMzNode1_kNm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
ln = Line(StartPoint=getbeamnodes.Node13DPoint, EndPoint=getbeamnodes.Node23DPoint)

# ----
# QUADs
getquadnodes = GetQUADNodes(
    TrueFalse=toggle,
    CDBPath=cdb_path,
    FirstSOFiSTiKGroups=first_group,
    LastSOFiSTiKGroups=last_group,
    DLLFolder="C:\Program Files\SOFiSTiK\2020\SOFiSTiK 2020\interfaces\64bit")  # -> QuadNumber, QuadNode1, QuadNode2, QuadNode3, QuadNode4, Node13DPoint, Node23DPoint, Node33DPoint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
getquadforces = GetQUADForces(
    TrueFalse=toggle,
    CDBPath=cdb_path,
    FirstSOFiSTiKGroups=first_group,
    LastSOFiSTiKGroups=last_group,
    LoadCases=load_cases,
    DLLFolder="C:\Program Files\SOFiSTiK\2020\SOFiSTiK 2020\interfaces\64bit")  # -> QUADNumber, BendingMomentMxx, BendingMomentMyy, BendingMomentMxy, ShearForceVx, ShearForceVy, MembraneForceNxx, MembraneForceNyy, MembraneForceNxy
srf4pt = _4PointSurface(
    CornerA=getquadnodes.Node13DPoint,
    CornerB=getquadnodes.Node23DPoint,
    CornerC=getquadnodes.Node33DPoint,
    CornerD=getquadnodes.Node43DPoint)

# ----
# Show QUAD Results
showquadresults = ShowQUADResults(
    node_1_point=getquadnodes.Node13DPoint,
    node_2_point=getquadnodes.Node23DPoint,
    node_3_point=getquadnodes.Node33DPoint,
    node_4_point=getquadnodes.Node43DPoint,
    result=getquadforces.BendingMomentMxx)  # -> vertices_2, max_value_2, min_value_2, result_4
gradient = Gradient(
    LowerLimit=showquadresults.min_value_2,
    UpperLimit=showquadresults.max_value_2,
    Parameter=showquadresults.result_4,
    stops=[0: RGB(234, 38, 0), 0.25: RGB(234, 126, 0), 0.5: RGB(254, 244, 84), 0.75: RGB(173, 203, 249), 1: RGB(75, 107, 169)])
conmesh = ConstructMesh(Vertices=showquadresults.vertices_2, Faces={A=0, B=1, C=2, D=3}, Colours=gradient)
area = Area(Geometry=conmesh)  # -> Area, Centroid
xz = XZPlane(Origin=area.Centroid)
int = Integer(showquadresults.result_4)
tag = TextTag3D(Location=xz, Text=int, Size=50, Justification=7)

# ----
# Show BEAM Results
number_slider = Slider(10, range=0..20)
deplane = DeconstructPlane(Plane=getbeamnodes.LocalCoordinates)  # -> Origin, XAxis, YAxis, ZAxis
showbeamresults = ShowBeamResults(
    node_1_point=getbeamnodes.Node13DPoint,
    node_2_point=getbeamnodes.Node23DPoint,
    direction=deplane.ZAxis,
    result_node_1=getbeamforces.BendingMomentMyNode1_kNm,
    result_node_2=getbeamforces.BendingMomentMyNode2_kNm,
    factor=number_slider)  # -> start_point_2, end_point_2, result_start_2, result_end_2, max_2, min_2, lines_2, all_results_2
gradient_2 = Gradient(
    LowerLimit=showbeamresults.max_2,
    UpperLimit=showbeamresults.min_2,
    Parameter=showbeamresults.all_results_2,
    stops=[0: RGB(234, 38, 0), 0.25: RGB(234, 126, 0), 0.5: RGB(254, 244, 84), 0.75: RGB(173, 203, 249), 1: RGB(75, 107, 169)])
yz = YZPlane(Origin=showbeamresults.start_point_2)
int_2 = Integer(showbeamresults.result_start_2)
preview = CustomPreview(Geometry=showbeamresults.lines_2, Material=gradient_2)
tag_2 = TextTag3D(Location=yz, Text=int_2, Size=200, Justification=7)

# ----
# Start SOFiSTiK
button = Button()
startsofistik2020 = StartSOFiSTiK2020(
    CDBPath=cdb_path,
    StartSSD=False,
    StartAnimator=button,
    StartWinGRAF=Button(),
    StartResultViewer=False,
    StartTeddy=False,
    StartWPS=False,
    StartExport=False,
    RunModel=False,
    SilentMode=False)

# ----
# Info
getinfo = GetInfo(TrueFalse=toggle, CDBPath=cdb_path, DLLFolder="C:\Program Files\SOFiSTiK\2020\SOFiSTiK 2020\interfaces\64bit")  # -> LoadCases, GroupNumbers, FirstElementNumber, LastElementNumber

# ----
# General
getsupportforces = GetSupportForces(
    TrueFalse=toggle,
    CDBPath=cdb_path,
    GlobalOrLocalCoordinates="Global",
    LoadCases=load_cases,
    DLLFolder="C:\Program Files\SOFiSTiK\2020\SOFiSTiK 2020\interfaces\64bit")  # -> NodesNumber, Nodes3DPoint, LocalCoordinates, PxSupportForces, PySupportForces, PzSupportForces, MxSupportMoments, MySupportMoments, MzSupportMoments
getdisplacement = GetDisplacement(
    TrueFalse=toggle,
    CDBPath=cdb_path,
    FirstSOFiSTiKGroups=first_group,
    LastSOFiSTiKGroups=last_group,
    LoadCases=load_cases,
    DLLFolder="C:\Program Files\SOFiSTiK\2020\SOFiSTiK 2020\interfaces\64bit")  # -> NodesNumber, Nodes3DPoint, XDispalcement, YDispalcement, ZDispalcement, XRotation, YRotation, ZRotation
getnodalloads = GetNodalLoads(
    TrueFalse=toggle,
    CDBPath=cdb_path,
    LoadCases=load_cases,
    DLLFolder="C:\Program Files\SOFiSTiK\2020\SOFiSTiK 2020\interfaces\64bit")  # -> NodesNumber, Nodes3DPoint, FLoad, MLoad

factor = Slider(7820, range=0..10000)
vec = VectorXYZ(
    XComponent=getdisplacement.XDispalcement,
    YComponent=getdisplacement.YDispalcement,
    ZComponent=getdisplacement.ZDispalcement)  # -> Vector, Length
vec_2 = VectorXYZ(
    XComponent=getdisplacement.XDispalcement,
    YComponent=getdisplacement.YDispalcement,
    ZComponent=getdisplacement.ZDispalcement)  # -> Vector, Length
showbeamdisplacement = ShowBeamDisplacement(
    node_1_point=getbeamnodes.Node13DPoint,
    node_2_point=getbeamnodes.Node23DPoint,
    displacement_points=getdisplacement.Nodes3DPoint,
    vector=vec.Vector,
    factor=factor)  # -> start_point_2, end_point_2, result_start_2, result_end_2, max_2, min_2, lines_2, all_results_2
showquaddisplacement = ShowQUADDisplacement(
    node_1=getquadnodes.QuadNode1,
    node_2=getquadnodes.QuadNode2,
    node_3=getquadnodes.QuadNode3,
    node_4=getquadnodes.QuadNode4,
    node_1_point=getquadnodes.Node13DPoint,
    node_2_point=getquadnodes.Node23DPoint,
    node_3_point=getquadnodes.Node33DPoint,
    node_4_point=getquadnodes.Node43DPoint,
    all_nodes_displ=getdisplacement.NodesNumber,
    displacement=vec_2.Vector)  # -> vertices_2, max_value_2, min_value_2, displacement_4, vector_2
gradient_3 = Gradient(
    LowerLimit=showquaddisplacement.max_value_2,
    UpperLimit=showquaddisplacement.min_value_2,
    Parameter=showquaddisplacement.displacement_4,
    stops=[0: RGB(234, 38, 0), 0.25: RGB(234, 126, 0), 0.5: RGB(254, 244, 84), 0.75: RGB(173, 203, 249), 1: RGB(75, 107, 169)])
vlen = VectorLength(Vector=showquaddisplacement.vector_2)
yz_2 = YZPlane(Origin=showbeamdisplacement.start_point_2)
multiplication = Multiplication(A=showbeamdisplacement.result_start_2, B=1000)
gradient_4 = Gradient(
    LowerLimit=showbeamdisplacement.max_2,
    UpperLimit=showbeamdisplacement.min_2,
    Parameter=showbeamdisplacement.all_results_2,
    stops=[0: RGB(234, 38, 0), 0.25: RGB(234, 126, 0), 0.5: RGB(254, 244, 84), 0.75: RGB(173, 203, 249), 1: RGB(75, 107, 169)])
multiplication_2 = Multiplication(A=vlen, B=factor)
amp = Amplitude(Vector=showquaddisplacement.vector_2, Amplitude=multiplication_2)
move = Move(Geometry=showquaddisplacement.vertices_2, Motion=amp)  # -> Geometry, Transform
xz_2 = XZPlane(Origin=showquaddisplacement.vertices_2)
multiplication_3 = Multiplication(A=showquaddisplacement.displacement_4, B=1000)
int_3 = Integer(multiplication_3)
int_4 = Integer(multiplication)

# ----
# Switch on Preview
# to see Displacement
conmesh_2 = ConstructMesh(Vertices=move.Geometry, Faces={A=0, B=1, C=2, D=3}, Colours=gradient_3)
preview_2 = CustomPreview(Geometry=showbeamdisplacement.lines_2, Material=gradient_4)
tag_3 = TextTag3D(Location=yz_2, Text=int_4, Size=200, Justification=7)
tag_4 = TextTag3D(Location=xz_2, Text=int_3, Size=120, Justification=7)

# ==== cluster ShowQUADDisplacement
io = IO(
    SofistikDocumentProperties_VersionMajor="2020",
    SofistikDocumentProperties_VersionMinor="8",
    SofistikDocumentProperties_VersionName="Rhino-Interface")
node_1 = ClusterInput()
node_2 = ClusterInput()
node_3 = ClusterInput()
node_4 = ClusterInput()
node_1_point = ClusterInput()
node_2_point = ClusterInput()
node_3_point = ClusterInput()
node_4_point = ClusterInput()
all_nodes_displ = ClusterInput()
displacement = ClusterInput()
node_1_2 = Data(node_1)
node_1_point_2 = Data(node_1_point)
node_2_2 = Data(node_2)
node_3_2 = Data(node_3)
node_4_2 = Data(node_4)
node_2_point_2 = Data(node_2_point)
node_3_point_2 = Data(node_3_point)
node_4_point_2 = Data(node_4_point)
all_nodes_displ_2 = Data(all_nodes_displ)
displacement_2 = Data(displacement)
entwine = Entwine(Branch00=node_1_2, Branch01=node_2_2, Branch02=node_3_2, Branch03=node_4_2, FlattenInputs=True)
entwine_2 = Entwine(Branch00=node_1_point_2, Branch01=node_2_point_2, Branch02=node_3_point_2, Branch03=node_4_point_2, FlattenInputs=True)
vlen = VectorLength(Vector=displacement_2)
flip = FlipMatrix(Data=entwine)
flip_2 = FlipMatrix(Data=entwine_2)
mindex = MemberIndex(Set=all_nodes_displ_2, Member=flip)  # -> Index, Count
item = ListItem(List=vlen, Index=mindex.Index, Wrap=True)
item_2 = ListItem(List=displacement_2, Index=mindex.Index, Wrap=True)
shift = ShiftPaths(Data=item, Offset=-1)
shift_2 = ShiftPaths(Data=item_2, Offset=-1)
flatten = FlattenTree(Tree=shift, Path="{0}")
sort = SortList(Keys=flatten, ValuesA=flatten)  # -> Keys, ValuesA
item_3 = ListItem(List=sort.ValuesA, Index=0, Wrap=True)  # -> Item1, Item
displacement_3 = Data(shift)
max_value = Data(item_3.Item1)
min_value = Data(item_3.Item)
vector = Data(shift_2)
vertices = Data(flip_2)
vertices_2 = ClusterOutput(vertices)
max_value_2 = ClusterOutput(max_value)
min_value_2 = ClusterOutput(min_value)
displacement_4 = ClusterOutput(displacement_3)
vector_2 = ClusterOutput(vector)

# ==== cluster ShowQUADResults
io = IO(
    SofistikDocumentProperties_VersionMajor="2020",
    SofistikDocumentProperties_VersionMinor="8",
    SofistikDocumentProperties_VersionName="Rhino-Interface")
result = ClusterInput()
node_1_point = ClusterInput()
node_2_point = ClusterInput()
node_3_point = ClusterInput()
node_4_point = ClusterInput()
node_1_point_2 = Data(node_1_point)
node_2_point_2 = Data(node_2_point)
node_3_point_2 = Data(node_3_point)
node_4_point_2 = Data(node_4_point)
result_2 = Data(result)
entwine = Entwine(Branch00=result_2, Branch01=result_2, Branch02=result_2, Branch03=result_2, FlattenInputs=True)
entwine_2 = Entwine(Branch00=node_1_point_2, Branch01=node_2_point_2, Branch02=node_3_point_2, Branch03=node_4_point_2, FlattenInputs=True)
flip = FlipMatrix(Data=entwine)
flip_2 = FlipMatrix(Data=entwine_2)
flatten = FlattenTree(Tree=flip, Path="{0}")
sort = SortList(Keys=flatten, ValuesA=flatten)  # -> Keys, ValuesA
item = ListItem(List=sort.ValuesA, Index=0, Wrap=True)  # -> Item1, Item
max_value = Data(item.Item1)
min_value = Data(item.Item)
vertices = Data(flip_2)
result_3 = Data(flip)
vertices_2 = ClusterOutput(vertices)
max_value_2 = ClusterOutput(max_value)
min_value_2 = ClusterOutput(min_value)
result_4 = ClusterOutput(result_3)

# ==== cluster ShowBeamResults
io = IO(
    SofistikDocumentProperties_VersionMajor="2020",
    SofistikDocumentProperties_VersionMinor="8",
    SofistikDocumentProperties_VersionName="Rhino-Interface")
node_1_point = ClusterInput()
node_2_point = ClusterInput()
direction = ClusterInput()
result_node_1 = ClusterInput()
result_node_2 = ClusterInput()
factor = ClusterInput()
result_node_1_2 = Data(result_node_1)
result_node_2_2 = Data(result_node_2)
node_1_point_2 = Data(node_1_point)
node_2_point_2 = Data(node_2_point)
direction_2 = Data(direction)
factor_2 = Data(factor)
multiplication = Multiplication(A=result_node_1_2, B=factor_2)
multiplication_2 = Multiplication(A=result_node_2_2, B=factor_2)
merge = Merge(Data1=result_node_1_2, Data2=result_node_2_2)
sort = SortList(Keys=merge, ValuesA=merge)  # -> Keys, ValuesA
amp = Amplitude(Vector=direction_2, Amplitude=multiplication_2)
amp_2 = Amplitude(Vector=direction_2, Amplitude=multiplication)
item = ListItem(List=sort.ValuesA, Index=0, Wrap=True)  # -> Item1, Item
move = Move(Geometry=node_2_point_2, Motion=amp)  # -> Geometry, Transform
move_2 = Move(Geometry=node_1_point_2, Motion=amp_2)  # -> Geometry, Transform
ln = Line(StartPoint=move_2.Geometry, EndPoint=move.Geometry)
curvepoint = PointOnCurve(ln, parameter=0.5)
ln_2 = Line(StartPoint=curvepoint, EndPoint=move.Geometry)
ln_3 = Line(StartPoint=move_2.Geometry, EndPoint=curvepoint)
entwine = Entwine(Branch00=result_node_1_2, Branch01=result_node_2_2, FlattenInputs=True)
entwine_2 = Entwine(Branch00=ln_3, Branch01=ln_2, FlattenInputs=True)
flip = FlipMatrix(Data=entwine)
flip_2 = FlipMatrix(Data=entwine_2)
item_2 = ListItem(List=flip_2, Index=0, Wrap=True)  # -> Item, Item1
item_3 = ListItem(List=flip, Index=0, Wrap=True)  # -> Item, Item1
end = EndPoints(Curve=item_2.Item)  # -> Start, End
end_2 = EndPoints(Curve=item_2.Item1)  # -> Start, End
result_start = Data(item_3.Item)
start_point = Data(end.Start)
result_end = Data(item_3.Item1)
all_results = Data(flip)
end_point = Data(end_2.End)
max = Data(item.Item1)
min = Data(item.Item)
lines = Data(flip_2)
result_start_2 = ClusterOutput(result_start)
start_point_2 = ClusterOutput(start_point)
result_end_2 = ClusterOutput(result_end)
all_results_2 = ClusterOutput(all_results)
end_point_2 = ClusterOutput(end_point)
max_2 = ClusterOutput(max)
min_2 = ClusterOutput(min)
lines_2 = ClusterOutput(lines)

# ==== cluster ShowBeamDisplacement
io = IO(
    SofistikDocumentProperties_VersionMajor="2020",
    SofistikDocumentProperties_VersionMinor="8",
    SofistikDocumentProperties_VersionName="Rhino-Interface")
node_1_point = ClusterInput()
node_2_point = ClusterInput()
displacement_points = ClusterInput()
vector = ClusterInput()
factor = ClusterInput()
displacement_points_2 = Data(displacement_points)
node_1_point_2 = Data(node_1_point)
node_2_point_2 = Data(node_2_point)
vector_2 = Data(vector)
cp = ClosestPoint(Point=node_1_point_2, Cloud=displacement_points_2)  # -> ClosestPoint, CPIndex, Distance
cp_2 = ClosestPoint(Point=node_2_point_2, Cloud=displacement_points_2)  # -> ClosestPoint, CPIndex, Distance
factor_2 = Data(factor)
item = ListItem(List=vector_2, Index=cp.CPIndex, Wrap=True)
vlen = VectorLength(Vector=item)
result_node_1 = Data(vlen)
item_2 = ListItem(List=vector_2, Index=cp_2.CPIndex, Wrap=True)
vlen_2 = VectorLength(Vector=item_2)
result_node_2 = Data(vlen_2)
multiplication = Multiplication(A=result_node_1, B=factor_2)
multiplication_2 = Multiplication(A=result_node_2, B=factor_2)
merge = Merge(Data1=result_node_1, Data2=result_node_2)
sort = SortList(Keys=merge, ValuesA=merge)  # -> Keys, ValuesA
amp = Amplitude(Vector=item_2, Amplitude=multiplication_2)
amp_2 = Amplitude(Vector=item, Amplitude=multiplication)
item_3 = ListItem(List=sort.ValuesA, Index=0, Wrap=True)  # -> Item1, Item
move = Move(Geometry=node_2_point_2, Motion=amp)  # -> Geometry, Transform
move_2 = Move(Geometry=node_1_point_2, Motion=amp_2)  # -> Geometry, Transform
ln = Line(StartPoint=move_2.Geometry, EndPoint=move.Geometry)
curvepoint = PointOnCurve(ln, parameter=0.5)
ln_2 = Line(StartPoint=curvepoint, EndPoint=move.Geometry)
ln_3 = Line(StartPoint=move_2.Geometry, EndPoint=curvepoint)
entwine = Entwine(Branch00=result_node_1, Branch01=result_node_2, FlattenInputs=True)
entwine_2 = Entwine(Branch00=ln_3, Branch01=ln_2, FlattenInputs=True)
flip = FlipMatrix(Data=entwine)
flip_2 = FlipMatrix(Data=entwine_2)
item_4 = ListItem(List=flip, Index=0, Wrap=True)  # -> Item, Item1
item_5 = ListItem(List=flip_2, Index=0, Wrap=True)  # -> Item, Item1
end = EndPoints(Curve=item_5.Item)  # -> Start, End
end_2 = EndPoints(Curve=item_5.Item1)  # -> Start, End
result_start = Data(item_4.Item)
start_point = Data(end.Start)
result_end = Data(item_4.Item1)
all_results = Data(flip)
end_point = Data(end_2.End)
max = Data(item_3.Item1)
min = Data(item_3.Item)
lines = Data(flip_2)
result_start_2 = ClusterOutput(result_start)
start_point_2 = ClusterOutput(start_point)
result_end_2 = ClusterOutput(result_end)
all_results_2 = ClusterOutput(all_results)
end_point_2 = ClusterOutput(end_point)
max_2 = ClusterOutput(max)
min_2 = ClusterOutput(min)
lines_2 = ClusterOutput(lines)
